# Grasshopper definition ConvertCoords.gh (Grasshopper 1.0.7)
# plug-ins: BH.UI.Grasshopper

node = Node(Latitude="53.348215", Longitude="-6.265600", Component="{ .Node")
toutmpoint = ToUTMPoint(Node=node, Component="{ .ToUTMPoint")
# OR look up UTM zone: http://www.dmap.co.uk/utmworld.htm
utmzonefromlongitude = UTMZoneFromLongitude(Longitude="-6.265600", Component="{ .UTMZoneFromLongitude")
pdecon = Deconstruct(Point=toutmpoint)  # -> XComponent, YComponent, ZComponent
utmtolatlon = UTMtoLatLon(
    Easting=pdecon.XComponent,
    Northing=pdecon.YComponent,
    Zone=utmzonefromlongitude,
    SouthernHemi=Toggle(False),
    Component="{ .UTMtoLatLon")
