# Grasshopper definition SearchInPolygon.gh (Grasshopper 1.0.7)
# plug-ins: BH.UI.Grasshopper

# To get an understanding of OpenStreet Map see: https://wiki.openstreetmap.org/wiki/Map_Features
# Searching for trees and footpaths in a Polygon within Dublin
panel = Panel("""53.347746
53.347746
53.34867
53.349595
53.350519
53.351443
53.352367
53.352367
53.353276
53.3541839
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""")
panel_2 = Panel("""-6.251975
-6.251975
-6.251494
-6.2510139
-6.250533
-6.250052
-6.249572
-6.249572
-6.248484
-6.247397
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""")
cull_pattern = CullPattern(List=panel, CullPattern=[False, False, False, True])
cull_pattern_2 = CullPattern(List=panel_2, CullPattern=[False, False, False, True])
createdictionary = CreateDictionary(Keys="natural", Values="tree", Component="{ .CreateDictionary")
createdictionary_2 = CreateDictionary(Keys="highway", Values="footway", Component="{ .CreateDictionary")
node = Node(Latitude=cull_pattern, Longitude=cull_pattern_2, Component="BH.oM.OpenStreetMap.Node")
node_2 = Node(Keyvalues=createdictionary, Component="BH.oM.OpenStreetMap.Node")
way = Way(Keyvalues=createdictionary_2, Component="BH.oM.OpenStreetMap.Way")
polygon = Polygon(Nodes=node, Component="BH.oM.OpenStreetMap.Polygon")
querybuilder = QueryBuilder(Region=polygon, Elements=way, Component="{ .QueryBuilder")
querybuilder_2 = QueryBuilder(Region=polygon, Elements=node_2, Component="{ .QueryBuilder")
toutmpoint = ToUTMPoint(Node=node, Component="{ .ToUTMPoint")
point = Point(toutmpoint)
explode = Explode(Object=querybuilder, Component="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")  # -> QueryString, BHoM_Guid, Name, Fragments, Tags, CustomData
explode_2 = Explode(Object=querybuilder_2, Component="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")  # -> QueryString, BHoM_Guid, Name, Fragments, Tags, CustomData
polyline = PolyLine(Vertices=point, Closed=Toggle(True))

# ----
# ENABLE ONE BY ONE TO QUERY
getrequest = GetRequest(Uri=explode.QueryString, Component="{ .GetRequest")  # disabled
getrequest_2 = GetRequest(Uri=explode_2.QueryString, Component="{ .GetRequest")  # disabled

toelementcontainer = ToElementContainer(OpenStreetMapQueryJSONResult=getrequest_2, Component="{ .ToElementContainer")
toelementcontainer_2 = ToElementContainer(OpenStreetMapQueryJSONResult=getrequest, Component="{ .ToElementContainer")
explode_3 = Explode(Object=toelementcontainer_2, Component="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")  # -> Nodes, Ways, BHoM_Guid, Name, Fragments, Tags, CustomData
explode_4 = Explode(Object=toelementcontainer, Component="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")  # -> Nodes, Ways, BHoM_Guid, Name, Fragments, Tags, CustomData
toutmpolyline = ToUTMPolyline(Way=explode_3.Ways, Component="{ .ToUTMPolyline")
toutmpoint_2 = ToUTMPoint(Node=explode_4.Nodes, Component="{ .ToUTMPoint")
